# Grasshopper definition field_000.gh (Grasshopper 0.9.76)

depth_min = Slider(1.8, range=0..24)
srf = Surface(<surface referenced from the Rhino model>)
c_script = CSharpScript(
    tree_cnt=Slider(12, range=0..20),
    branch_fx=Slider(2, range=0..10),
    lattice_rows=Slider(8, range=0..20),
    shift_fx=Slider(0, range=0..20),
    achor_center=Toggle(True),
    ring_bool=Toggle(False),
    depth_max=Slider(45, range=0..45),
    depth_min=depth_min)  # -> A, B, C, pts_anchors, E, opacity_fx, length_max, length_min; inputs tree_cnt: Int32, branch_fx: Int32, lattice_rows: Int32, shift_fx: Int32, achor_center: Boolean, ring_bool: Boolean, ring_crvs: tree of Curve, ring_compression: Curve, pt_center: Point3d, depth_max: Double, depth_min: Double
# ---------- c_script: C# ----------
    DataTree<int> div = new DataTree<int>();
    DataTree<Point3d> pts = new DataTree<Point3d>();
    DataTree<Line> lines = new DataTree<Line>();
    DataTree<Point3d> pts_lattice = new DataTree<Point3d>();

    int cnt = ring_crvs.BranchCount;
    int fx = branch_fx;
    int d = 0;
    int index_crv = 0;

    ///POINTS ALONG RINGS
    for(int i = 0; i < cnt; i++){
      GH_Path path = new GH_Path(index_crv);
      if(i == 0){
        d = tree_cnt;
      } else{
        d = (d * fx);
      }

      div.Add(d, path);
      Point3d[] pts_array;

      Curve crv = ring_crvs.Branches[i][0];
      crv.DivideByCount(d, true, out pts_array);
      pts.AddRange(pts_array, path);
      index_crv += 1;
    }

    ///OUTER RING
    GH_Path path_00 = new GH_Path(index_crv);
    div.Add(d, path_00);

    Point3d[] pts_arr;
    ring_compression.DivideByCount(d, true, out pts_arr);
    pts.AddRange(pts_arr, path_00);
    index_crv += 1;

    List<Point3d> pts_anchor = new List<Point3d>();
    pts_anchor.AddRange(pts_arr);

    ///SET ANCHOR POINTS
    if(achor_center == true){
      pts_anchor.Add(pt_center);
    }

    ///TREE TRUNKS
    for(int i = 0; i < tree_cnt; i++){
      GH_Path path = new GH_Path(0);
      Point3d pt_S = pt_center;
      Point3d pt_E = pts.Branches[0][i];

      Line line = new Line(pt_S, pt_E);
      lines.Add(line, path);
    }

    ///TREE BRANCHES
    for(int i = 0; i < cnt - 1; i++){
      int pt_cnt = pts.Branches[i].Count();
      GH_Path path = new GH_Path(i + 1);

      for(int j = 0; j < pt_cnt; j++){
        for(int k = 0; k < fx; k++){
          int index = j * branch_fx + k - shift_fx;

          if(index < 0){
            index = pts.Branches[i + 1].Count() + index;
          }
          if(fx == 2 && i == cnt - 2 && index > 0 && index % 2 == 1 ){
            index += 1;
            if(index > pts.Branches[i + 1].Count() - 1){
              index = 0;
            }
          }
          Point3d pt_00 = pts.Branches[i][j];
          Point3d pt_01 = pts.Branches[i + 1][index];
          Line l = new Line(pt_00, pt_01);
          lines.Add(l, path);
        }
      }
    }
    ///RING EDGES
    if(ring_bool == true){
      for(int i = 0; i < cnt; i++){
        int cnt_div = pts.Branches[i].Count;
        for(int j = 0; j < cnt_div; j++){
          GH_Path path = new GH_Path(12, i);
          int index_j = j + 1;
          if(index_j == cnt_div){
            index_j = 0;
          }
          Point3d pt_00 = pts.Branches[i][j];
          Point3d pt_01 = pts.Branches[i][index_j];

          Line l_00 = new Line(pt_00, pt_01);
          lines.Add(l_00, path);
        }
      }
    }
    ///LEAF LATTICE GRID POINTS
    int div_elem = lattice_rows;
    double len_max = 0;
    double len_min = 10000;
    DataTree<Line> leaf_cl = new DataTree<Line>();
    DataTree<double> opac_fx = new DataTree<double>();

    for(int i = 0; i < d; i++){
      GH_Path path = new GH_Path(0);
      Point3d pt_S = pts.Branches[index_crv - 2][i];
      Point3d pt_E = pts.Branches[index_crv - 1][i];

      Line line = new Line(pt_S, pt_E);
      leaf_cl.Add(line, path);
    }

    for(int i = 0; i < d; i++){
      GH_Path path = new GH_Path(i);
      Point3d[] pts_array;
      Line l = leaf_cl.Branches[0][i];
      Curve crv = l.ToNurbsCurve();
      crv.DivideByCount(div_elem, true, out pts_array);
      pts_lattice.AddRange(pts_array, path);
    }
    //CONSTRUCT QUADS
    DataTree<Point3d> pts_quad = new DataTree<Point3d>();
    int path_index = 0;
    for(int i = 0; i < pts_lattice.BranchCount; i++){
      for(int j = 0; j < div_elem ; j++){
        
        int index_quad_col = i + 1;
        if(index_quad_col == pts_lattice.BranchCount){
          index_quad_col = 0;
        }
        
        Point3d pt_00 = pts_lattice.Branches[i][j + 1];
        Point3d pt_01 = pts_lattice.Branches[i][j];
        Point3d pt_02 = pts_lattice.Branches[index_quad_col][j];
        Point3d pt_03 = pts_lattice.Branches[index_quad_col][j + 1];

        pts_quad.Add(pt_00, new GH_Path(path_index));
        pts_quad.Add(pt_01, new GH_Path(path_index));
        pts_quad.Add(pt_02, new GH_Path(path_index));
        pts_quad.Add(pt_03, new GH_Path(path_index));
        
        path_index += 1;
      }
    }
    //CONSTRUCT SPACE FRAME ELEMENTS
    for(int i = 0; i < pts_lattice.BranchCount; i++){
      for(int j = 0; j < div_elem; j++){

        int index_01 = i + 1;
        if( index_01 >= pts_lattice.BranchCount){
          index_01 = 0;
        }

        if(i % 2 == 1 && j % 2 == 1){

          GH_Path path = new GH_Path(10, i);

          //TOP CHORD
          Point3d pt_00 = pts_lattice.Branches[i][j];
          Point3d pt_01 = pts_lattice.Branches[index_01][j + 1];
          Point3d pt_02 = pts_lattice.Branches[i - 1][j + 1];

          Line l_00 = new Line(pt_00, pt_01);
          Line l_01 = new Line(pt_00, pt_02);

          lines.Add(l_00, path);
          lines.Add(l_01, path);

          //BOTTOM CHORD
          double t = 0;
          ring_compression.ClosestPoint(pt_00, out t);
          Point3d pt_near = ring_compression.PointAt(t);
          double depth_fx0 = pt_00.DistanceTo(pt_near) / 200;

          ring_compression.ClosestPoint(pt_01, out t);
          pt_near = ring_compression.PointAt(t);
          double depth_fx1 = pt_01.DistanceTo(pt_near) / 200;
          ring_compression.ClosestPoint(pt_02, out t);
          pt_near = ring_compression.PointAt(t);
          double depth_fx2 = pt_02.DistanceTo(pt_near) / 200;

          Point3d pt_B0 = pt_00;
          Point3d pt_B1 = pt_01;
          Point3d pt_B2 = pt_02;

          pt_B0.Z -= depth_max * depth_fx0 + depth_min;
          pt_B1.Z -= depth_max * depth_fx1 + depth_min;
          pt_B2.Z -= depth_max * depth_fx2 + depth_min;

          Line l_B0 = new Line(pt_B0, pt_00);
          Line l_B1 = new Line(pt_00, pt_B1);
          Line l_B2 = new Line(pt_00, pt_B2);
          Line l_B3 = new Line(pt_B0, pt_B1);
          Line l_B4 = new Line(pt_B0, pt_B2);

          Line l_B5 = new Line(pt_01, pt_B1);
          Line l_B6 = new Line(pt_02, pt_B2);

          lines.Add(l_B0, path);
          lines.Add(l_B1, path);
          lines.Add(l_B2, path);
          lines.Add(l_B3, path);
          lines.Add(l_B4, path);
          lines.Add(l_B5, path);
          lines.Add(l_B6, path);
        }

        if(i % 2 == 1 && j % 2 == 0){

          GH_Path path = new GH_Path(10, i);

          Point3d pt_01 = pts_lattice.Branches[index_01][j];
          Point3d pt_02 = pts_lattice.Branches[i - 1][j];
          Point3d pt_00 = pts_lattice.Branches[i][j + 1];

          Line l_00 = new Line(pt_00, pt_01);
          Line l_01 = new Line(pt_00, pt_02);

          lines.Add(l_00, path);
          lines.Add(l_01, path);

          //BOTTOM CHORD
          double t = 0;
          ring_compression.ClosestPoint(pt_00, out t);
          Point3d pt_near = ring_compression.PointAt(t);
          double depth_fx0 = pt_00.DistanceTo(pt_near) / 200;

          ring_compression.ClosestPoint(pt_01, out t);
          pt_near = ring_compression.PointAt(t);
          double depth_fx1 = pt_01.DistanceTo(pt_near) / 200;
          ring_compression.ClosestPoint(pt_02, out t);
          pt_near = ring_compression.PointAt(t);
          double depth_fx2 = pt_02.DistanceTo(pt_near) / 200;

          Point3d pt_B0 = pt_00;
          Point3d pt_B1 = pt_01;
          Point3d pt_B2 = pt_02;

          pt_B0.Z -= depth_max * depth_fx0 + depth_min;
          pt_B1.Z -= depth_max * depth_fx1 + depth_min;
          pt_B2.Z -= depth_max * depth_fx2 + depth_min;

          Line l_B1 = new Line(pt_00, pt_B1);
          Line l_B2 = new Line(pt_00, pt_B2);
          Line l_B3 = new Line(pt_B0, pt_B1);
          Line l_B4 = new Line(pt_B0, pt_B2);

          lines.Add(l_B1, path);
          lines.Add(l_B2, path);
          lines.Add(l_B3, path);
          lines.Add(l_B4, path);
        }
      }
    }
    ///SET LENGTH DOMAIN
    for(int i = 0; i < lines.BranchCount ;i++){
      for(int j = 0; j < lines.Branches[i].Count(); j++){

        double len = lines.Branches[i][j].Length;
        if(len > len_max){
          len_max = len;
        }
        if(len < len_min){
          len_min = len;
        }
      }
    }


    A = div;
    B = pts;
    C = lines;
    pts_anchors = pts_anchor;
    E = pts_quad;

    opacity_fx = 0.0;
    length_min = len_min;
    length_max = len_max;
# ---------- end c_script ----------
heat_map = CSharpScript()  # -> weight; inputs crv_00: Curve, crv_01: Curve, pts: tree of Point3d
# ---------- heat_map: C# ----------
    int cnt = pts.BranchCount;

    DataTree<double> vals = new DataTree<double>();
    for(int i = 0; i < cnt; i++){

      double t0 = 0.0;
      double t1 = 0.0;
      crv_00.ClosestPoint(pts.Branches[i][0], out t0);
      crv_01.ClosestPoint(pts.Branches[i][0], out t1);
      Point3d pt_00 = crv_00.PointAt(t0);
      Point3d pt_01 = crv_01.PointAt(t1);

      double L0 = pt_00.DistanceTo(pts.Branches[i][0]);
      double L1 = pt_01.DistanceTo(pts.Branches[i][0]);
      double LT = L0 + L1;

      double val = L0 / LT;
      vals.Add(val, new GH_Path(i));
    }

    weight = vals;
# ---------- end heat_map ----------
sdivide = DivideSurface(Surface=srf, UCount=Slider(15, range=0..50), VCount=Slider(22, range=0..50))  # -> Points, Normals, Parameters
quad_grid = CSharpScript(pts_UV=sdivide.Points)  # -> PTS; inputs pts_UV: tree of Point3d
# ---------- quad_grid: C# ----------
    DataTree <Point3d> pts = new DataTree <Point3d>();
    int count;
    int index = 0;

    int cnt = pts_UV.BranchCount;

    for(int i = 0; i < cnt - 1; i++){
      count = pts_UV.Branches[i].Count();

      for(int j = 0; j < count - 1; j++){
        GH_Path path = new GH_Path(index);

        Point3d pt0 = pts_UV.Branches[i][j];
        Point3d pt1 = pts_UV.Branches[i + 1][j];
        Point3d pt2 = pts_UV.Branches[i + 1][j + 1];
        Point3d pt3 = pts_UV.Branches[i][j + 1];

        pts.Add(pt0, path);
        pts.Add(pt1, path);
        pts.Add(pt2, path);
        pts.Add(pt3, path);

        index += 1;
      }
    }

      PTS = pts;
# ---------- end quad_grid ----------
pline = PolyLine(Vertices=quad_grid, Closed=True)
pframe = PerpFrame(Curve=pline, Parameter=0)
pt = Point(<point referenced from the Rhino model>)
item = ListItem(List=quad_grid, Index=0, Wrap=True)
pt_2 = Point(item)
number_slider = Slider(0.25, range=0..1)
number_slider_2 = Slider(8, range=4..15)
dom = ConstructDomain(DomainStart=0, DomainEnd=5)
cir = Circle(Plane=pt, Radius=number_slider)
divide = DivideCurve(Curve=cir, Count=number_slider_2, Kinks=False)  # -> Points, Tangents, Parameters
cp = ClosestPoint(Point=divide.Points, Cloud=flatten(sdivide.Points))  # -> simplify(graft(ClosestPoint)), CPIndex, Distance
panel = Panel(cp.ClosestPoint)

# ----
# You need to merge fields before use them together.
# Turn-on to see vectors
pt_3 = Point(<point referenced from the Rhino model>)
spin_charge = Slider(5, range=0..5)
pt_4 = Point([<point referenced from the Rhino model> x6])
pt_charge = Slider(12.1, range=0..15)
md_slider = MDSlider(
    slider_value=Point(0.5760975349, 0.570975513, 0.5),
    SliderMode=0,
    x_domain=Domain(0, 3),
    y_domain=Domain(0, 3),
    z_domain=Domain(0, 1))
charges_sample_points = Slider(24, range=2..50)
base_sample_pt = Slider(35, range=2..50)
vector_field_scale_div = Slider(9, range=1..15)
color_value_cut = Slider(38.7, range=0..100)
vect_line = Line(StartPoint=Point(0, 0, 0), EndPoint=md_slider)
range = Range(Domain=Domain(0, 20), Steps=base_sample_pt)
fvector = VectorForce(
    Line=vect_line,
    Bounds={Plane=Plane(origin=(0, 0, 0), x=(0, 1, 0), y=(1, 0, 0)), X=Domain(0, 20), Y=Domain(0, 20), Z=Domain(-20, 0)})
fspin = SpinForce(
    Plane=pt_3,
    Strength=spin_charge,
    Radius=5,
    Decay=2,
    Bounds={Plane=PlaneXY(0, 0, 0), X=Domain(0, 20), Y=Domain(0, 20), Z=Domain(0, 20)})
pcharge = PointCharge(
    Point=pt_4,
    Charge=pt_charge,
    Decay=2,
    Bounds={Plane=Plane(origin=(0, 0, 0), x=(0, 1, 0), y=(1, 0, 0)), X=Domain(0, 20), Y=Domain(0, 20), Z=Domain(-20, 0)})
cir_2 = Circle(Plane=pt_4, Radius=1)
pt_5 = PointXYZ(XComponent=graft(range), YComponent=range, ZComponent=0, System=PlaneXY(0, 0, 0))
divide_2 = DivideCurve(Curve=cir_2, Count=charges_sample_points, Kinks=False)  # -> Points, Tangents, Parameters
mergef = MergeFields(Fields=[pcharge, fvector, fspin])
pt_analysis_samples = Point([divide_2.Points, pt_5])
fline = FieldLine(Field=mergef, Point=flatten(pt_analysis_samples), Steps=500, Accuracy=0.03, Method=1)
evf = EvaluateField(Field=mergef, Point=flatten(pt_analysis_samples))  # -> Tensor, Strength
division = Division(A=evf.Tensor, B=vector_field_scale_div)

# ----
# Turn-on to see force direction graph.
fdir = DirectionDisplay(Field=mergef, Section={Plane=PlaneXY(0, 0, 0), Size=Domain2(u=0..20, v=0..20)}, Samples=10000)

# ---- group: Taking out upper extremes
smaller = SmallerThan(FirstNumber=evf.Strength, SecondNumber=color_value_cut)  # -> SmallerThan, OrEqualTo
cull = CullPattern(List=evf.Strength, CullPattern=smaller.SmallerThan)

# ----
bnd = Bounds(Numbers=cull)
domcomp = DomainComponents(Domain=bnd)  # -> Start, End
gradient = Gradient(
    LowerLimit=domcomp.Start,
    UpperLimit=domcomp.End,
    Parameter=evf.Strength,
    stops=[0: RGB(234, 38, 0), 0: RGB(130, 183, 154), 0.296: RGB(234, 126, 0), 0.641: RGB(254, 244, 84), 0.892: RGB(173, 203, 249), 1: RGB(75, 107, 169)])
vdisex = VectorDisplayEx(Point=flatten(pt_analysis_samples), Vector=division, Colour=gradient, Width=2)
preview = CustomPreview(Geometry=fline, Shader=gradient)

field = Field(mergef)
evf_2 = EvaluateField(Field=field, Point=pt_2)  # -> Tensor, Strength
c_script_2 = CSharpScript(v=evf_2.Strength)  # -> v_min, v_max; inputs v: tree of Double
# ---------- c_script_2: C# ----------
    double min = 100000000;
    double max = -100000000;

    int cnt = v.BranchCount;

    for(int i = 0; i < cnt; i++){
      double val = v.Branches[i][0];

      if(val > max){
        max = val;
      }
      if(val < min){
        min = val;
      }
    }

    v_min = min;
    v_max = max;
# ---------- end c_script_2 ----------
dom_2 = ConstructDomain(DomainStart=c_script_2.v_min, DomainEnd=c_script_2.v_max)
remap = RemapNumbers(Value=evf_2.Strength, Source=dom_2, Target=dom)  # -> Mapped, Clipped
dom_3 = ConstructDomain(DomainStart=0, DomainEnd=remap.Mapped)
dom_4 = ConstructDomain(DomainStart=0, DomainEnd=remap.Mapped)
evf_3 = EvaluateField(Field=field, Point=cp.ClosestPoint)  # -> simplify(graft(Tensor)), simplify(graft(Strength))
rectangle = Rectangle(Plane=pframe, XSize=dom_3, YSize=dom_4, Radius=0)  # -> Rectangle, Length
c_script_3 = CSharpScript(f_pos=cp.ClosestPoint, f_vec=evf_3.Tensor, f_mag=evf_3.Strength, pt=pt)  # -> pts, branch, count; inputs f_pos: tree of Point3d, f_vec: tree of Vector3d, f_mag: tree of Double, pt: Point3d
# ---------- c_script_3: C# ----------
    DataTree<Point3d> pts_E = new DataTree<Point3d>();
    DataTree<Line> branches = new DataTree<Line>();
    Point3d pt_S = pt;

    int cnt = f_mag.BranchCount;
    double max = -100000000;
    int index_0 = 0;
    int index_1 = 0;

    for(int i = 0; i < cnt; i++){
      double val = f_mag.Branches[i][0];
      if(val > max){
        max = val;
        index_0 = i;
      }
    }

    max = -100000000;
    for(int i = 0; i < cnt; i++){
      if(i != index_0){
        double val = f_mag.Branches[i][0];
        if(val >= max){
          max = val;
          index_1 = i;
        }
      }
    }

    Line ln_00 = new Line(pt, f_pos.Branches[index_0][0]);
    Line ln_01 = new Line(pt, f_pos.Branches[index_1][0]);

    branches.Add(ln_00, new GH_Path(0));
    branches.Add(ln_01, new GH_Path(1));

    pts_E.Add(f_pos.Branches[index_0][0], new GH_Path(0));
    pts_E.Add(f_pos.Branches[index_1][0], new GH_Path(0));

    pts = pts_E;
    branch = branches;
    count = index_0;
# ---------- end c_script_3 ----------
c_script_4 = CSharpScript(F_mag=evf_2.Strength, F_pos=pt_2, Search_pts=divide.Points)  # -> Mag, Pos
c_script_5 = CSharpScript(
    f=field,
    f_pos=pt_2,
    f_vec=evf_2.Tensor,
    f_mag=evf_2.Strength,
    agent_pos=pt,
    search_rad=number_slider,
    search_vecs=number_slider_2)  # -> pts; inputs f_pos: Point3d, f_vec: Vector3d, f_mag: tree of Double, agent_pos: tree of Point3d, search_rad: Double, search_vecs: Int32
# ---------- c_script_5: C# ----------
    DataTree<Point3d> pts_search = new DataTree<Point3d>();
    GH_Path path = new GH_Path();

    for(int i = 0; i < search_vecs; i++){

      //agent_pos
      double r = search_rad;
      double theta = (360 / search_vecs) * i;


      //pts_search.Add(pt,path);

    }
# ---------- end c_script_5 ----------
pt_6 = Point(c_script_3.pts)
line = Line(c_script_3.branch)
panel_2 = Panel(evf_2.Strength)
panel_3 = Panel(evf_3.Strength)
panel_4 = Panel(c_script_3.count)
swp1 = Sweep1(Rail=pline, Sections=rectangle.Rectangle, Miter=1)
panel_5 = Panel(evf_2.Tensor)
