# Grasshopper definition framer 1.gh (Grasshopper 0.9.76)
# plug-ins: Kangaroo Components, PlanktonGh

crv = Curve([<curve referenced from the Rhino model> x3])
# C:\Program Files (x86)\Computers and Structures\SAP2000 18\CSi_OAPI_Documentation.chm
getsap18 = VBScript(run=Button(), Reference="C:\Program Files (x86)\Computers and Structures\SAP2000 18\SAP2000v18.dll")  # -> out, SapModel
# ---------- getsap18: VB ----------
    If run Then

      ' - attach to running SAP - - - - - - - - - - - - - - - - - - - - - - - - -
      'BV_Model10_R8.sdb

      Dim mySapObject As cOAPI
      mySapObject = Nothing

      'attach to a running instance of Sap2000
      'get the active Sap2000 object
      mySapObject = GetObject(, "CSI.SAP2000.API.SapObject")
      AppActivate("SAP2000")

      'Get a reference to cSapModel to access all OAPI classes and functions
      'Dim mySapModel As cSapModel
      mySapModel = mySapObject.SapModel

    End If


    SapModel_ = mySapModel
# ---------- getsap18: VB additional code ----------
  Private Shared mySapModel As cSapModel
# ---------- end getsap18 ----------
loft = Loft(Curves=crv, Options={Adjust=False, Closed=False, LoftEnds=0, LoftSimp=0, LoftType=0, Rebuild=10, Refit=0.01})
meshmachine = MeshMachine(
    Geometry=loft,
    Length=Slider(9.11, range=1..100),
    Flip=1,
    PullStrength=0.8,
    CurvatureAdaptivity=Slider(1, range=0..1),
    BoundaryScale=1,
    BoundaryDistance=5,
    Exponent=2,
    Background=0.5,
    Iterations=1,
    Reset=Toggle(True))
pmesh = PlanktonMesh(meshmachine)
mesh = Mesh(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)
getareas = VBScript(
    SapModel=getsap18.SapModel,
    run=Button(),
    Reference="C:\Program Files (x86)\Computers and Structures\SAP2000 18\SAP2000v18.dll")  # -> out, PtNames, AreaNames
# ---------- getareas: VB ----------
    Dim mySapModel As csapmodel
    mySapModel = CType(_SapModel, cSapModel)
    Dim ret As Long

    If run Then
      PtNames.clear
      AreaNames.clear

      Dim namecount As Double
      Dim AreaNamesArr() As String : AreaNamesArr = Nothing
      ret = mySapModel.AreaObj.GetNameList(NameCount, AreaNamesArr)
      AreaNames.addrange(AreaNamesArr.ToList)

      For i As Integer = 0 To ubound(AreaNamesArr)

        Dim PtCount As Long
        Dim PtNamesArr() As String : PtNamesArr = nothing
        ret = mySapModel.AreaObj.GetPoints(AreaNamesArr(i), PtCount, PtNamesArr)

        PtNames.addrange(PtNamesArr.ToList, New GH_Path(i))

      Next


    End If

    PtNames_ = PtNames
    AreaNames_ = AreaNames
# ---------- getareas: VB additional code ----------
  Private Shared PtNames As New datatree(Of String)
  Private Shared AreaNames As New list(Of String)
# ---------- end getareas ----------
medges = MeshEdges(Mesh=mesh)  # -> NakedEdges, InteriorEdges, NonManifoldEdges
demesh = DeconstructMesh(Mesh=mesh)  # -> Vertices, Faces, Colours, Normals
deface = DeconstructFace(Face=demesh.Faces)  # -> CornerA, CornerB, CornerC, CornerD
addpts = VBScript(
    SapModel=getsap18.SapModel,
    Pts=demesh.Vertices,
    run=Button(),
    Reference="C:\Program Files (x86)\Computers and Structures\SAP2000 18\SAP2000v18.dll")  # -> out, PtNames; inputs Pts: list of Point3d
# ---------- addpts: VB ----------
    Dim mySapModel As csapmodel
    mySapModel = CType(_SapModel, cSapModel)
    Dim ret As Long

    If run Then
      PtNames.clear
      ret = Nothing

      'Dim namecount As Double
      'Dim AreaNamesArr() As String : AreaNamesArr = Nothing
      'ret = mySapModel.AreaObj.GetNameList(NameCount, AreaNamesArr)

      For i As Integer = 0 To _pts.count() - 1

        Dim ptname As String = nothing
        'Dim PtCount As Long
        'Dim PtNamesArr() As String : PtNamesArr = nothing
        'ret = mySapModel.AreaObj.GetPoints(AreaNamesArr(i), PtCount, PtNamesArr)

        'PtNames.addrange(PtNamesArr.ToList, New GH_Path(i))

        mySapModel.PointObj.AddCartesian(_pts(i).X, _pts(i).Y, _pts(i).Z, ptname)
        PtNames.add(ptname)

      Next


    End If

    PtNames_ = PtNames
# ---------- addpts: VB additional code ----------
  Private Shared PtNames As New List(Of String)
# ---------- end addpts ----------
brep = Brep(<brep referenced from the Rhino model>)
movepts18 = VBScript(run=Button(), Reference="C:\Program Files (x86)\Computers and Structures\SAP2000 18\SAP2000v18.dll")  # -> out, Pts, PtNames; inputs PtNames: list, NewPts: list of Point3d
# ---------- movepts18: VB ----------
    Dim mySapModel As csapmodel
    mySapModel = CType(_SapModel, cSapModel)
    Dim ret As Long

    ' - - - - - - - - - - - - - - - - - - - - - + - - - + - - - + - - - + - - - +
    If run

      For i As Integer = 0 To _PtNames.count() - 1

        ret = mySapModel.EditPoint.ChangeCoordinates(_PtNames(i), _NewPts(i).X, _NewPts(i).Y, _NewPts(i).Z)

      Next

      print(ret)
    End If
# ---------- end movepts18 ----------
brepinc = PointInBrep(Brep=brep, Point=demesh.Vertices, Strict=False)
number_slider = Slider(14, range=0..80)
number_slider_2 = Slider(68, range=0..80)
cluster = Cluster(txt=addpts.PtNames, i=deface.CornerA, i_2=deface.CornerB, i_3=deface.CornerC, i_4=deface.CornerD)
cull = CullPattern(List=demesh.Vertices, CullPattern=brepinc)
cull_2 = CullPattern(List=addpts.PtNames, CullPattern=brepinc)
item = ListItem(List=cull, Index=number_slider, Wrap=True)
item_2 = ListItem(List=cull, Index=number_slider_2, Wrap=True)
rec = DataRecorder(movepts18.out, DataLimit=-10, RecordData=True)
addareas = VBScript(
    SapModel=getsap18.SapModel,
    Faces=cluster,
    run=Button(),
    Reference="C:\Program Files (x86)\Computers and Structures\SAP2000 18\SAP2000v18.dll")  # -> out, AreaNames; inputs Faces: tree
# ---------- addareas: VB ----------
    Dim mySapModel As csapmodel
    mySapModel = CType(_SapModel, cSapModel)
    Dim ret As Long

    If run Then
      AreaNames.clear
      ret = Nothing

      For i As Integer = 0 To _Faces.BranchCount() - 1

        Dim areaname As String = Nothing
        mySapModel.AreaObj.AddByPoint(4, _Faces.Branch(i).ToArray(), areaname)
        AreaNames.add(areaname)

      Next


    End If

    AreaNames_ = AreaNames
# ---------- addareas: VB additional code ----------
  Private Shared AreaNames As New List(Of String)
# ---------- end addareas ----------
getframes = VBScript(run=Button(), Reference="C:\Program Files (x86)\Computers and Structures\SAP2000 18\SAP2000v18.dll")  # -> out, FrameLines, FrameNames, JointNamesJ, JointNamesL, Sections
# ---------- getframes: VB ----------
    Dim mySapModel As csapmodel
    mySapModel = CType(_SapModel, cSapModel)


    If run Then

      FrameNames = Nothing
      FrameLines.Clear
      JointNames_J.clear
      JointNames_L.Clear
      Sections.Clear

      ' - Query model - - - - - - - - - - - - - - - - - - - - + - - - + - - - + - - - + - - - +
      Dim ret As Long

      Dim FrameCount As Int32

      ret = mySapModel.FrameObj.GetNameList(FrameCount, FrameNames)

      For i As Integer = 0 To FrameCount - 1
        Dim pt1 As String : pt1 = Nothing
        dim pt2 as string : pt2 = nothing
        Dim x1, y1, z1, x2, y2, z2 As Double
        Dim propname As String : PropName = Nothing
        Dim SAuto  As String : SAuto = Nothing
        ret = mySapModel.FrameObj.GetPoints(FrameNames(i), pt1, pt2)
        JointNames_J.add(pt1)
        JointNames_L.add(pt2)
        ret = mySapModel.PointObj.GetCoordCartesian(pt1, x1, y1, z1)
        ret = mySapModel.PointObj.GetCoordCartesian(pt2, x2, y2, z2)
        FrameLines.add(New line(x1, y1, z1, x2, y2, z2))
        ret = mySapModel.FrameObj.GetSection(FrameNames(i), PropName, SAuto)
        Sections.add(PropName)
      Next

      'Get forces + visualize!!



    End If

    FrameLines_ = FrameLines
    FrameNames_ = FrameNames
    JointNamesJ_ = JointNames_J
    JointNamesL_ = JointNames_L
    Sections_ = Sections
# ---------- getframes: VB additional code ----------
  Private Shared FrameNames() As String
  Private Shared FrameLines As New list(Of Line)
  Private Shared JointNames_J As New list(Of String)
  Private Shared JointNames_L As New list(Of String)
  Private Shared Sections As New list(Of String)
# ---------- end getframes ----------
cull_i = CullIndex(List=cull_2, Indices=number_slider, Wrap=True)
item_3 = ListItem(List=cull_2, Index=number_slider, Wrap=True)
panel = Panel("""False
False
True
False
False
False""")
item_4 = ListItem(List=cull_2, Index=number_slider_2, Wrap=True)
panel_2 = Panel("""True
True
True
False
False
False""")
setrestraint = VBScript(
    SapModel=getsap18.SapModel,
    PtNames=cull_i,
    Restraint=panel,
    run=Button(),
    Reference="C:\Program Files (x86)\Computers and Structures\SAP2000 18\SAP2000v18.dll")  # -> out, A; inputs PtNames: list, Restraint: list
# ---------- setrestraint: VB ----------
    Dim mySapModel As csapmodel
    mySapModel = CType(_SapModel, cSapModel)
    Dim ret As Long


    ' - - - - - - - - - - - - - - - - - - - - - + - - - + - - - + - - - + - - - +
    If run Then

      For i As Integer = 0 To _PtNames.count() - 1

        ret = mySapModel.PointObj.setRestraint(_PtNames(i), _Restraint.ToArray)

      Next

    End If
# ---------- end setrestraint ----------
panel_3 = Panel("""0.0001
0.0001
0
0
0
0""")
setrestraint_2 = VBScript(
    SapModel=getsap18.SapModel,
    PtNames=item_3,
    Restraint=panel_2,
    run=Button(),
    Reference="C:\Program Files (x86)\Computers and Structures\SAP2000 18\SAP2000v18.dll")  # -> out, A; inputs PtNames: list, Restraint: list; same code as setrestraint
getforces = VBScript(LoadCase="SDL", run=Button(), Reference="C:\Program Files (x86)\Computers and Structures\SAP2000 17\SAP2000v17.dll")  # -> out, V, M; inputs FrameNames: list
# ---------- getforces: VB ----------
    Dim mySapModel As csapmodel
    mySapModel = CType(_SapModel, cSapModel)
    Dim ret As Long

    If run Then

      V.Clear
      M.clear

      Dim PList As New list(Of Double)
      Dim V2List As New list(Of Double)
      Dim V3List As New list(Of Double)
      Dim TList As New list(Of Double)
      Dim M2List As New list(Of Double)
      Dim M3List As New list(Of Double)


      Dim NumberResults As Long
      Dim ObjSta(), ElmSta() as double
      Dim Obj(),  Elm(),  LoadCase(), StepType()  As String
      obj = Nothing
      ObjSta = Nothing
      Elm = Nothing
      ElmSta = Nothing
      loadcase = Nothing
      steptype = Nothing
      Dim StepNum(), P(), V2(), V3(), T(), M2(), M3() As Double
      StepNum = Nothing
      P = Nothing
      V2 = Nothing
      V3 = Nothing
      T = Nothing
      M2 = Nothing
      M3 = Nothing

      ret = mySapModel.Results.Setup.SetCaseSelectedForOutput(_LoadCase)
      For i As Integer = 0 To _FrameNames.count() - 1
        ret = mySapModel.Results.FrameForce(_FrameNames(i), eItemTypeElm.ObjectElm, NumberResults, Obj, ObjSta, Elm, ElmSta, LoadCase, StepType, StepNum, P, V2, V3, T, M2, M3)
        print(NumberResults.tostring)
        Plist.add(P(0))
        V2List.add(V2(0))
        V3List.add(V3(0))
        Tlist.add(T(0))
        M2List.add(M2(0))
        M3List.add(M3(0))
      Next

      V.AddRange(Plist, New GH_Path(0))
      V.AddRange(V2list, New GH_Path(1))
      V.AddRange(V3list, New GH_Path(2))
      M.AddRange(Tlist, New GH_Path(0))
      M.AddRange(M2list, New GH_Path(1))
      M.AddRange(M3list, New GH_Path(2))

    End If
    V_ = V
    M_ = M
# ---------- getforces: VB additional code ----------
  Private Shared V As New DataTree(Of Double)
  Private Shared M As New DataTree(Of Double)
# ---------- end getforces ----------
rec_2 = DataRecorder(setrestraint.out, DataLimit=-10, RecordData=True)
setspring = VBScript(
    SapModel=getsap18.SapModel,
    PtNames=item_4,
    Spring=panel_3,
    run=Button(),
    Reference="C:\Program Files (x86)\Computers and Structures\SAP2000 18\SAP2000v18.dll")  # -> out, A; inputs PtNames: list, Spring: list
# ---------- setspring: VB ----------
    Dim mySapModel As csapmodel
    mySapModel = CType(_SapModel, cSapModel)
    Dim ret As Long


    ' - - - - - - - - - - - - - - - - - - - - - + - - - + - - - + - - - + - - - +
    If run Then

      For i As Integer = 0 To _PtNames.count() - 1

        ret = mySapModel.PointObj.SetSpring(_PtNames(i), _Spring.ToArray)

      Next

    End If
# ---------- end setspring ----------
panel_4 = Panel("""1
1
1
1
1
1
1
1
1
0""")
panel_5 = Panel(rec_2)
areaload = VBScript(
    SapModel=getsap18.SapModel,
    AreaNames=addareas.AreaNames,
    LoadPattern="DEAD",
    Load="0.04",
    run=Button(),
    Reference="C:\Program Files (x86)\Computers and Structures\SAP2000 18\SAP2000v18.dll")  # -> out, A; inputs AreaNames: list
# ---------- areaload: VB ----------
    Dim mySapModel As csapmodel
    mySapModel = CType(_SapModel, cSapModel)
    Dim ret As Long


    ' - - - - - - - - - - - - - - - - - - - - - + - - - + - - - + - - - + - - - +
    If run Then




      For i As Integer = 0 To _AreaNames.count() - 1

        print(_areanames(i))
        ret = mySapModel.AreaObj.SetLoadUniform(_AreaNames(i), _LoadPattern, _Load, 10)
        print(ret)

      Next

    End If
# ---------- end areaload ----------
propmod = VBScript(
    SapModel=getsap18.SapModel,
    PropName="ASEC1",
    Modifier=panel_4,
    run=Button(),
    Reference="C:\Program Files (x86)\Computers and Structures\SAP2000 18\SAP2000v18.dll")  # -> out, A; inputs Modifier: list
# ---------- propmod: VB ----------
    Dim mySapModel As csapmodel
    mySapModel = CType(_SapModel, cSapModel)
    Dim ret As Long


    ' - - - - - - - - - - - - - - - - - - - - - + - - - + - - - + - - - + - - - +
    If run Then

      ret = mySapModel.PropArea.SetModifiers(_PropName, _Modifier.ToArray())

    End If
# ---------- end propmod ----------
panel_6 = Panel(areaload.A)
rec_3 = DataRecorder(areaload.out, DataLimit=-10, RecordData=True)

# ----
# IMPORTANT NOTE: Your model must have a file path defined before running the analysis.
runanalysis = VBScript(
    SapModel=getsap18.SapModel,
    run=Button(),
    Reference="C:\Program Files (x86)\Computers and Structures\SAP2000 18\SAP2000v18.dll")  # -> out
# ---------- runanalysis: VB ----------
    Dim mySapModel As csapmodel
    mySapModel = CType(_SapModel, cSapModel)
    Dim ret As Long

    ' - - - - - - - - - - - - - - - - - - - - - + - - - + - - - + - - - + - - - +
    If run Then

      ret = mySapModel.Analyze.RunAnalysis()
      print(ret)

    End If
# ---------- end runanalysis ----------

areaforce = VBScript(
    SapModel=getsap18.SapModel,
    AreaNames=addareas.AreaNames,
    run=Button(),
    Reference="C:\Program Files (x86)\Computers and Structures\SAP2000 18\SAP2000v18.dll")  # -> out, MMax; inputs AreaNames: list
# ---------- areaforce: VB ----------
    Dim mySapModel As csapmodel
    mySapModel = CType(_SapModel, cSapModel)
    Dim ret As Long


    ' - - - - - - - - - - - - - - - - - - - - - + - - - + - - - + - - - + - - - +
    If run Then
      _MMax.clear

      For i As Integer = 0 To _AreaNames.count() - 1

        Dim NumberResults As Double = Nothing
        Dim Obj() As String = Nothing
        Dim Elm() As String = Nothing
        Dim PointElm() As String = Nothing
        Dim LoadCase() As String = Nothing
        Dim StepType() As String = Nothing
        Dim StepNum() As Double = Nothing
        Dim F11() As Double = Nothing
        Dim F22() As Double = Nothing
        Dim F12() As Double = Nothing
        Dim FMax() As Double = Nothing
        Dim FMin() As Double = Nothing
        Dim FAngle() As Double = Nothing
        Dim FVM() As Double = Nothing
        Dim M11() As Double = Nothing
        Dim M22() As Double = Nothing
        Dim M12() As Double = Nothing
        Dim MMax() As Double = Nothing
        Dim MMin() As Double = Nothing
        Dim MAngle() As Double = Nothing
        Dim V13() As Double = Nothing
        Dim V23() As Double = Nothing
        Dim VMax() As Double = Nothing
        Dim VAngle() As Double = Nothing

        ret = mySapModel.Results.AreaForceShell(_AreaNames(i), 0, NumberResults, Obj, Elm, PointElm, LoadCase, StepType, StepNum, F11, F22, F12, FMax, FMin, FAngle, FVM, M11, M22, M12, MMax, MMin, MAngle, V13, V23, VMax, VAngle)

        _MMax.add(MMax(0))

      Next

    End If

    MMax_ = _MMax
# ---------- areaforce: VB additional code ----------
  Private Shared _MMax As New list(Of Double)
# ---------- end areaforce ----------
getdispl = VBScript(
    SapModel=getsap18.SapModel,
    PtNames=addpts.PtNames,
    LoadCase="SDL",
    run=Button(),
    Reference="C:\Program Files (x86)\Computers and Structures\SAP2000 18\SAP2000v18.dll")  # -> out, U, R; inputs PtNames: list
# ---------- getdispl: VB ----------
    Dim mySapModel As csapmodel
    mySapModel = CType(_SapModel, cSapModel)
    Dim ret As Long

    If run Then

      U.Clear
      R.clear

      Dim U1List As New list(Of Double)
      Dim U2List As New list(Of Double)
      Dim U3List As New list(Of Double)
      Dim R1List As New list(Of Double)
      Dim R2List As New list(Of Double)
      Dim R3List As New list(Of Double)

      Dim NumberResults As Long
      Dim Obj(), Elm(), LoadCase(), StepType()  As String
      obj = Nothing
      elm = Nothing
      loadcase = Nothing
      steptype = Nothing
      Dim StepNum(), U1(), U2(), U3(), R1(), R2(), R3() As Double
      StepNum = Nothing
      u1 = Nothing
      u2 = Nothing
      u3 = Nothing
      r1 = Nothing
      r2 = Nothing
      r3 = nothing

      ret = mySapModel.Results.Setup.SetCaseSelectedForOutput(_LoadCase)
      For i As Integer = 0 To _PtNames.count() - 1
        ret = mySapModel.Results.JointDispl(_PtNames(i), eItemTypeElm.ObjectElm, NumberResults, Obj, Elm, LoadCase, StepType, StepNum, U1, U2, U3, R1, R2, R3)
        U1list.add(U1(0))
        U2List.add(U2(0))
        U3List.add(U3(0))
        R1list.add(R1(0))
        R2List.add(R2(0))
        R3List.add(R3(0))
      Next

      U.AddRange(U1list, New GH_Path(0))
      U.AddRange(U2list, New GH_Path(1))
      U.AddRange(U3list, New GH_Path(2))
      R.AddRange(R1list, New GH_Path(0))
      R.AddRange(R2list, New GH_Path(1))
      R.AddRange(R3list, New GH_Path(2))

    End If
    U_ = U
    R_ = R
# ---------- getdispl: VB additional code ----------
  Private Shared U as new DataTree(of double)
  Private Shared R As New DataTree(Of Double)
# ---------- end getdispl ----------
rec_4 = DataRecorder(runanalysis, DataLimit=-10, RecordData=True)
num = Number([-89.09918447, -91.32724192, -95.94604238, 36.84270133, 3.990985994, 44.30487373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])
bnd = Bounds(Numbers=num)
dedomain = DeconstructDomain(Domain=bnd)  # -> Start, End
panel_7 = Panel(rec_4)
gradient = Gradient(
    LowerLimit=dedomain.Start,
    UpperLimit=dedomain.End,
    Parameter=num,
    stops=[0: RGB(234, 38, 0), 0.25: RGB(234, 126, 0), 0.5: RGB(254, 244, 84), 0.75: RGB(173, 203, 249), 1: RGB(75, 107, 169)])
item_5 = ListItem(List=demesh.Vertices, Index=deface.CornerA, Wrap=True)
item_6 = ListItem(List=demesh.Vertices, Index=deface.CornerB, Wrap=True)
item_7 = ListItem(List=demesh.Vertices, Index=deface.CornerC, Wrap=True)
item_8 = ListItem(List=demesh.Vertices, Index=deface.CornerD, Wrap=True)
srf4pt = _4PointSurface(CornerA=item_5, CornerB=item_6, CornerC=item_7, CornerD=item_8)
C = Colour(gradient)
preview = CustomPreview(Geometry=srf4pt, Shader=gradient)

# ==== cluster Cluster
txt = ClusterInput()
txt_2 = Text(txt)
i = ClusterInput()
i_2 = ClusterInput()
i_3 = ClusterInput()
i_4 = ClusterInput()
item = ListItem(List=txt_2, Index=i, Wrap=True)
item_2 = ListItem(List=txt_2, Index=i_2, Wrap=True)
item_3 = ListItem(List=txt_2, Index=i_3, Wrap=True)
item_4 = ListItem(List=txt_2, Index=i_4, Wrap=True)
path_mapper = PathMapper(item, source="{A;B}", target="{A;0}")
path_mapper_2 = PathMapper(item_2, source="{A;B}", target="{A;1}")
path_mapper_3 = PathMapper(item_3, source="{A;B}", target="{A;2}")
path_mapper_4 = PathMapper(item_4, source="{A;B}", target="{A;3}")
txt_3 = Text([path_mapper, path_mapper_4, path_mapper_2, path_mapper_3])
flip = FlipMatrix(Data=txt_3)  # -> simplify(Data)
D = ClusterOutput(flip)
