# Grasshopper definition space_frame_001.gh (Grasshopper 0.9.76)

depth_min = Slider(1.8, range=0..24)
pt = Point(Point(28.52296833, -3.441104575, 52.5614397))
crv = Curve(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)
crv_2 = Curve(Tree({0}: [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], {1}: [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], {2}: [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], {3}: [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], {4}: [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]))
c_script = CSharpScript(
    tree_cnt=Slider(12, range=0..20),
    branch_fx=Slider(2, range=0..10),
    lattice_rows=Slider(8, range=0..20),
    shift_fx=Slider(0, range=0..20),
    achor_center=Toggle(True),
    ring_bool=Toggle(False),
    ring_crvs=crv_2,
    ring_compression=crv,
    pt_center=pt,
    depth_max=Slider(45, range=0..45),
    depth_min=depth_min)  # -> A, B, C, pts_anchors, E, opacity_fx, length_max, length_min; inputs tree_cnt: Int32, branch_fx: Int32, lattice_rows: Int32, shift_fx: Int32, achor_center: Boolean, ring_bool: Boolean, ring_crvs: tree of Curve, ring_compression: Curve, pt_center: Point3d, depth_max: Double, depth_min: Double
# ---------- c_script: C# ----------
    DataTree<int> div = new DataTree<int>();
    DataTree<Point3d> pts = new DataTree<Point3d>();
    DataTree<Line> lines = new DataTree<Line>();
    DataTree<Point3d> pts_lattice = new DataTree<Point3d>();

    int cnt = ring_crvs.BranchCount;
    int fx = branch_fx;
    int d = 0;
    int index_crv = 0;

    ///POINTS ALONG RINGS
    for(int i = 0; i < cnt; i++){
      GH_Path path = new GH_Path(index_crv);
      if(i == 0){
        d = tree_cnt;
      } else{
        d = (d * fx);
      }

      div.Add(d, path);
      Point3d[] pts_array;

      Curve crv = ring_crvs.Branches[i][0];
      crv.DivideByCount(d, true, out pts_array);
      pts.AddRange(pts_array, path);
      index_crv += 1;
    }

    ///OUTER RING
    GH_Path path_00 = new GH_Path(index_crv);
    div.Add(d, path_00);

    Point3d[] pts_arr;
    ring_compression.DivideByCount(d, true, out pts_arr);
    pts.AddRange(pts_arr, path_00);
    index_crv += 1;

    List<Point3d> pts_anchor = new List<Point3d>();
    pts_anchor.AddRange(pts_arr);

    ///SET ANCHOR POINTS
    if(achor_center == true){
      //pts_anchor.Add(pt_center);
    }

    ///TREE TRUNKS
    for(int i = 0; i < tree_cnt; i++){
      GH_Path path = new GH_Path(0);
      Point3d pt_S = pt_center;
      Point3d pt_E = pts.Branches[0][i];

      Line line = new Line(pt_S, pt_E);
      //lines.Add(line, path);
    }

    ///TREE BRANCHES
    for(int i = 0; i < cnt - 1; i++){
      int pt_cnt = pts.Branches[i].Count();
      GH_Path path = new GH_Path(i + 1);

      for(int j = 0; j < pt_cnt; j++){
        for(int k = 0; k < fx; k++){
          int index = j * branch_fx + k - shift_fx;

          if(index < 0){
            index = pts.Branches[i + 1].Count() + index;
          }
          if(fx == 2 && i == cnt - 2 && index > 0 && index % 2 == 1 ){
            index += 1;
            if(index > pts.Branches[i + 1].Count() - 1){
              index = 0;
            }
          }
          Point3d pt_00 = pts.Branches[i][j];
          Point3d pt_01 = pts.Branches[i + 1][index];
          Line l = new Line(pt_00, pt_01);
          //lines.Add(l, path);
        }
      }
    }
    ///RING EDGES
    if(ring_bool == true){
      for(int i = 0; i < cnt; i++){
        int cnt_div = pts.Branches[i].Count;
        for(int j = 0; j < cnt_div; j++){
          GH_Path path = new GH_Path(12, i);
          int index_j = j + 1;
          if(index_j == cnt_div){
            index_j = 0;
          }
          Point3d pt_00 = pts.Branches[i][j];
          Point3d pt_01 = pts.Branches[i][index_j];

          Line l_00 = new Line(pt_00, pt_01);
          lines.Add(l_00, path);
        }
      }
    }
    ///LEAF LATTICE GRID POINTS
    int div_elem = lattice_rows;
    double len_max = 0;
    double len_min = 10000;
    DataTree<Line> leaf_cl = new DataTree<Line>();
    DataTree<double> opac_fx = new DataTree<double>();

    for(int i = 0; i < d; i++){
      GH_Path path = new GH_Path(0);
      Point3d pt_S = pts.Branches[index_crv - 2][i];
      Point3d pt_E = pts.Branches[index_crv - 1][i];

      Line line = new Line(pt_S, pt_E);
      leaf_cl.Add(line, path);
    }

    for(int i = 0; i < d; i++){
      GH_Path path = new GH_Path(i);
      Point3d[] pts_array;
      Line l = leaf_cl.Branches[0][i];
      Curve crv = l.ToNurbsCurve();
      crv.DivideByCount(div_elem, true, out pts_array);
      pts_lattice.AddRange(pts_array, path);
    }
    //CONSTRUCT QUADS
    DataTree<Point3d> pts_quad = new DataTree<Point3d>();
    int path_index = 0;
    for(int i = 0; i < pts_lattice.BranchCount; i++){
      for(int j = 0; j < div_elem ; j++){

        int index_quad_col = i + 1;
        if(index_quad_col == pts_lattice.BranchCount){
          index_quad_col = 0;
        }

        Point3d pt_00 = pts_lattice.Branches[i][j + 1];
        Point3d pt_01 = pts_lattice.Branches[i][j];
        Point3d pt_02 = pts_lattice.Branches[index_quad_col][j];
        Point3d pt_03 = pts_lattice.Branches[index_quad_col][j + 1];

        pts_quad.Add(pt_00, new GH_Path(path_index));
        pts_quad.Add(pt_01, new GH_Path(path_index));
        pts_quad.Add(pt_02, new GH_Path(path_index));
        pts_quad.Add(pt_03, new GH_Path(path_index));

        path_index += 1;
      }
    }
    //CONSTRUCT SPACE FRAME ELEMENTS
    for(int i = 0; i < pts_lattice.BranchCount; i++){
      for(int j = 0; j < div_elem; j++){

        int index_01 = i + 1;
        if( index_01 >= pts_lattice.BranchCount){
          index_01 = 0;
        }

        if(i % 2 == 1 && j % 2 == 1){

          GH_Path path = new GH_Path(10, i);

          //TOP CHORD
          Point3d pt_00 = pts_lattice.Branches[i][j];
          Point3d pt_01 = pts_lattice.Branches[index_01][j + 1];
          Point3d pt_02 = pts_lattice.Branches[i - 1][j + 1];

          Line l_00 = new Line(pt_00, pt_01);
          Line l_01 = new Line(pt_00, pt_02);

          lines.Add(l_00, path);
          lines.Add(l_01, path);

          //BOTTOM CHORD
          double t = 0;
          ring_compression.ClosestPoint(pt_00, out t);
          Point3d pt_near = ring_compression.PointAt(t);
          double depth_fx0 = pt_00.DistanceTo(pt_near) / 200;

          ring_compression.ClosestPoint(pt_01, out t);
          pt_near = ring_compression.PointAt(t);
          double depth_fx1 = pt_01.DistanceTo(pt_near) / 200;
          ring_compression.ClosestPoint(pt_02, out t);
          pt_near = ring_compression.PointAt(t);
          double depth_fx2 = pt_02.DistanceTo(pt_near) / 200;

          Point3d pt_B0 = pt_00;
          Point3d pt_B1 = pt_01;
          Point3d pt_B2 = pt_02;

          pt_B0.Z -= depth_max * depth_fx0 + depth_min;
          pt_B1.Z -= depth_max * depth_fx1 + depth_min;
          pt_B2.Z -= depth_max * depth_fx2 + depth_min;

          Line l_B0 = new Line(pt_B0, pt_00);
          Line l_B1 = new Line(pt_00, pt_B1);
          Line l_B2 = new Line(pt_00, pt_B2);
          Line l_B3 = new Line(pt_B0, pt_B1);
          Line l_B4 = new Line(pt_B0, pt_B2);

          Line l_B5 = new Line(pt_01, pt_B1);
          Line l_B6 = new Line(pt_02, pt_B2);

          lines.Add(l_B0, path);
          lines.Add(l_B1, path);
          lines.Add(l_B2, path);
          lines.Add(l_B3, path);
          lines.Add(l_B4, path);
          lines.Add(l_B5, path);
          lines.Add(l_B6, path);
        }

        if(i % 2 == 1 && j % 2 == 0){

          GH_Path path = new GH_Path(10, i);

          Point3d pt_01 = pts_lattice.Branches[index_01][j];
          Point3d pt_02 = pts_lattice.Branches[i - 1][j];
          Point3d pt_00 = pts_lattice.Branches[i][j + 1];

          Line l_00 = new Line(pt_00, pt_01);
          Line l_01 = new Line(pt_00, pt_02);

          lines.Add(l_00, path);
          lines.Add(l_01, path);

          //BOTTOM CHORD
          double t = 0;
          ring_compression.ClosestPoint(pt_00, out t);
          Point3d pt_near = ring_compression.PointAt(t);
          double depth_fx0 = pt_00.DistanceTo(pt_near) / 200;

          ring_compression.ClosestPoint(pt_01, out t);
          pt_near = ring_compression.PointAt(t);
          double depth_fx1 = pt_01.DistanceTo(pt_near) / 200;
          ring_compression.ClosestPoint(pt_02, out t);
          pt_near = ring_compression.PointAt(t);
          double depth_fx2 = pt_02.DistanceTo(pt_near) / 200;

          Point3d pt_B0 = pt_00;
          Point3d pt_B1 = pt_01;
          Point3d pt_B2 = pt_02;

          pt_B0.Z -= depth_max * depth_fx0 + depth_min;
          pt_B1.Z -= depth_max * depth_fx1 + depth_min;
          pt_B2.Z -= depth_max * depth_fx2 + depth_min;

          Line l_B1 = new Line(pt_00, pt_B1);
          Line l_B2 = new Line(pt_00, pt_B2);
          Line l_B3 = new Line(pt_B0, pt_B1);
          Line l_B4 = new Line(pt_B0, pt_B2);

          lines.Add(l_B1, path);
          lines.Add(l_B2, path);
          lines.Add(l_B3, path);
          lines.Add(l_B4, path);
        }
      }
    }
    ///SET LENGTH DOMAIN
    for(int i = 0; i < lines.BranchCount ;i++){
      for(int j = 0; j < lines.Branches[i].Count(); j++){

        double len = lines.Branches[i][j].Length;
        if(len > len_max){
          len_max = len;
        }
        if(len < len_min){
          len_min = len;
        }
      }
    }


    A = div;
    B = pts;
    C = lines;
    pts_anchors = pts_anchor;
    E = pts_quad;

    opacity_fx = 0.0;
    length_min = len_min;
    length_max = len_max;
# ---------- end c_script ----------
load_value = Slider(2, range=0..100)
rest_length = Slider(0.5, range=0..1)
stiffness = Slider(5, range=0..50)
item = ListItem(List=flatten(crv_2), Index=-1, Wrap=True)
scale_fx = Slider(0.6049, range=0.25..1)
line = Line(c_script.C)
dom = ConstructDomain(DomainStart=c_script.length_min, DomainEnd=c_script.length_max)
pt_2 = Point(c_script.B)
pt_3 = Point(c_script.pts_anchors)
pt_4 = Point(c_script.E)
heat_map = CSharpScript(crv_00=crv, crv_01=item, pts=pt_4)  # -> weight; inputs crv_00: Curve, crv_01: Curve, pts: tree of Point3d
# ---------- heat_map: C# ----------
    int cnt = pts.BranchCount;

    DataTree<double> vals = new DataTree<double>();
    for(int i = 0; i < cnt; i++){

      double t0 = 0.0;
      double t1 = 0.0;
      crv_00.ClosestPoint(pts.Branches[i][0], out t0);
      crv_01.ClosestPoint(pts.Branches[i][0], out t1);
      Point3d pt_00 = crv_00.PointAt(t0);
      Point3d pt_01 = crv_01.PointAt(t1);

      double L0 = pt_00.DistanceTo(pts.Branches[i][0]);
      double L1 = pt_01.DistanceTo(pts.Branches[i][0]);
      double LT = L0 + L1;

      double val = L0 / LT;
      vals.Add(val, new GH_Path(i));
    }

    weight = vals;
# ---------- end heat_map ----------
quad_cell = CSharpScript(
    pts=pt_4,
    depth=Slider(1.5, range=0.05..2),
    depth_fx=heat_map,
    scale_fx=scale_fx,
    edge_offset=Slider(0, range=0..1),
    e_max=Slider(0.1, range=0..5))  # -> cell_boundary, cell_centroid, cell_plane, cell_depth; inputs pts: tree of Point3d, depth: Double, depth_fx: tree of Double, scale_fx: Double, edge_offset: Double, e_max: Double
# ---------- quad_cell: C# ----------
    EDGE_OFFSET = edge_offset;

    DataTree <Curve> bounds = new DataTree <Curve>();
    DataTree <Plane> planes = new DataTree <Plane>();
    DataTree <Point3d> centroids = new DataTree <Point3d>();
    DataTree <Line> axes = new DataTree <Line>();

    int count = pts.BranchCount;
    double depth_factor = 0.0;

    for(int i = 0; i < count; i++){
      GH_Path path = new GH_Path(i);

      //SET DEPTH FX FOR TREE OR ITEM
      if(depth_fx.BranchCount > 1){
        depth_factor = depth_fx.Branches[i][0] + 0.001;
      } else {
        depth_factor = 1 - depth_fx.Branches[0][0];
      }


      List<Point3d> pts_quad = pts.Branches[i];
      //pts_quad = pts_planar(pts_quad);

      Polyline boundary = new Polyline(pts_quad);
      boundary.Add(boundary.PointAt(0));
      Point3d pt_Cen = boundary.CenterPoint();

      Point3d pt_0 = pts_quad[0];
      Point3d pt_1 = pts_quad[1];
      Point3d pt_2 = pts_quad[2];
      Point3d pt_3 = pts_quad[3];

      //Curve quad_00 = cell_offset(pts_quad);
      //bounds.Add(quad_00, path);

      double min_length = 1000000;
      double max_length = 0;

      Line e0 = new Line(pt_0, pt_1);
      Line e1 = new Line(pt_1, pt_2);
      Line e2 = new Line(pt_2, pt_3);
      Line e3 = new Line(pt_3, pt_0);

      if(e0.Length < min_length){
        min_length = e0.Length;
      }
      if(e1.Length < min_length){
        min_length = e1.Length;
      }
      if(e2.Length < min_length){
        min_length = e2.Length;
      }
      if(e3.Length < min_length){
        min_length = e3.Length;
      }


      if(e0.Length > max_length){
        max_length = e0.Length;
      }
      if(e1.Length > max_length){
        max_length = e1.Length;
      }
      if(e2.Length > max_length){
        max_length = e2.Length;
      }
      if(e3.Length > max_length){
        max_length = e3.Length;
      }

      if(depth > max_length){
        depth = max_length;
      }

      Rhino.Geometry.Plane plane = new Rhino.Geometry.Plane(pt_0, pt_1, pt_2);
      Vector3d vec = plane.Normal;
      vec.Reverse();
      plane.Origin = pt_Cen;

      Point3d pt_4 = pt_0 + (vec * ( depth * depth_factor));
      Point3d pt_5 = pt_0 + (vec * ( depth * depth_factor));

      Vector3d vec_B = pt_5 - pt_2;
      pt_5 = pt_2 + (vec_B * (1 - depth_factor  * 0.5));
      pt_4 = pt_5;
      
      //pt_5 = pt_2 + (vec_B * (scale_fx));

      List<Point3d> pts_00 = new List<Point3d>();
      List<Point3d> pts_01 = new List<Point3d>();
      List<Point3d> pts_02 = new List<Point3d>();
      List<Point3d> pts_03 = new List<Point3d>();

      pts_00.Add(pt_4);
      pts_00.Add(pt_0);
      pts_00.Add(pt_1);

      pts_01.Add(pt_5);
      pts_01.Add(pt_1);
      pts_01.Add(pt_2);

      pts_02.Add(pt_5);
      pts_02.Add(pt_2);
      pts_02.Add(pt_3);

      pts_03.Add(pt_4);
      pts_03.Add(pt_3);
      pts_03.Add(pt_0);

      Curve quad_0 = cell_offset(pts_00);
      Curve quad_1 = cell_offset(pts_01);
      Curve quad_2 = cell_offset(pts_02);
      Curve quad_3 = cell_offset(pts_03);

      if(e2.Length > e_max){
        bounds.Add(quad_0, path);
        bounds.Add(quad_1, path);
        bounds.Add(quad_2, path);
        bounds.Add(quad_3, path);
        planes.Add(plane, path);
      }
      //Line axis = new Line(pt_Cen, centroid);
      //axes.Add(axis, path);
      //centroids.Add(pt_Cen, path);

    }

    cell_boundary = bounds;
    cell_centroid = centroids;
    cell_plane = planes;
    cell_depth = axes;
# ---------- quad_cell: C# additional code ----------
  double EDGE_OFFSET = 0;

  Rhino.Geometry.Curve cell_offset(List<Point3d> verts){
    double dist = -EDGE_OFFSET;
    Rhino.Geometry.Plane plane = new Rhino.Geometry.Plane(verts[0], verts[1], verts[2]);
    Rhino.Geometry.PolyCurve crv = new Rhino.Geometry.PolyCurve();

    //CONSTRUCT BOUNDARIES
    Line e_00 = new Rhino.Geometry.Line(verts[0], verts[1]);
    Line e_01 = new Rhino.Geometry.Line(verts[1], verts[2]);
    Line e_02 = new Rhino.Geometry.Line(verts[2], verts[0]);
    //Line e_03 = new Rhino.Geometry.Line(verts[3], verts[0]);

    crv.Append(e_00);
    crv.Append(e_01);
    crv.Append(e_02);
    //crv.Append(e_03);
    /*
    if(dist == 0){
    return crv;
    }else{
    Rhino.Geometry.Curve[] pline = crv.Offset(plane, dist, 0.01, CurveOffsetCornerStyle.Sharp);
    return pline[0];
    }
    */
    return crv;
  }

  List<Point3d> pts_planar(List<Point3d> verts){
    Rhino.Geometry.Plane plane = new Rhino.Geometry.Plane(verts[0], verts[1], verts[2]);
    Point3d pt = plane.ClosestPoint(verts[3]);
    verts[3] = pt;

    return verts;
  }
  //
# ---------- end quad_cell ----------
end = EndPoints(Curve=line)  # -> Start, End
merge = Merge(Data1=end.Start, Data2=end.End)  # -> flatten(Result)
crv_3 = Curve(quad_cell.cell_boundary)
cullpt = CullDuplicates(Points=merge, Tolerance=0.1, CullMode=3)  # -> flatten(Points), Indices, Valence
boundary = BoundarySurfaces(Edges=crv_3)
relaxation = RELAXATION(
    reset=Toggle(False),
    x=load_value,
    B=rest_length,
    strength=stiffness,
    P_2=flatten(cullpt.Points),
    crv=flatten(c_script.C),
    P=flatten(c_script.pts_anchors))  # disabled
crv_4 = Curve(relaxation)
pipe = Pipe(Curve=flatten(line), Radius=0.15, Caps=0)

# ==== cluster RELAXATION
P = ClusterInput()
P_2 = ClusterInput()
crv = ClusterInput()
crv_2 = Curve(crv)
strength = ClusterInput()
reset = ClusterInput()
x = ClusterInput()
B = ClusterInput()
neg = Negative(Value=x)
vec = VectorXYZ(XComponent=0, YComponent=0, ZComponent=neg)  # -> Vector, Length
len = Length(Curve=crv_2)
multiplication = Multiplication(A=len, B=B)
pl = PlasticLength(Limit=1, Strength=1)
ct = ConstantTension(Line=crv_2, Strength=strength)
anchor = Anchor(Point=P, Strength=10000)
length_line = LengthLine(Line=crv_2, Length=multiplication, Strength=strength)
load = Load(Point=P_2, ForceVector=vec.Vector)
solver = Solver(GoalObjects=[load, ct, length_line, anchor], Reset=reset, Threshold=1e-15, Tolerance=0.01, On=True)  # -> I, V, O
O = ClusterOutput(solver.O)
